# Grasshopper definition RhinoToUnity.gh (Grasshopper 1.0.7)
# plug-ins: Human

crv = Curve(<curve referenced from the Rhino model>)  # disabled
pipeline = GeometryPipeline(
    GroupByLayer=False,
    GroupByType=False,
    IncludeHidden=True,
    IncludeLocked=True,
    LayerFilter="INSTANTIATE*",
    NameFilter="*",
    SublayerFiltering=True,
    TypeFilter=1)
panel = Panel("25")  # disabled
len = Length(Curve=crv)  # disabled
division = Division(A=len, B=panel)  # disabled
divide = DivideCurve(Curve=crv, Count=division, Kinks=False)  # -> Points, Tangents, Parameters; disabled
objatts = ObjectAttributes(ObjectOrAttributes=pipeline)  # -> Name, LayerName, LayerFullPath, Color, MaterialName, LinetypeName, GroupIndices, PlotWeight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
X = UnitX(Factor=1)
lng = ListLength(List=pipeline)
Z = UnitZ(Factor=1)
lng_2 = ListLength(List=pipeline)
dup = DuplicateData(Data=X, Number=lng, Order=True)
dup_2 = DuplicateData(Data=Z, Number=lng_2, Order=True)
c_script = CSharpScript(obj=objatts.LayerFullPath, pts=pipeline, fwd=dup, up=dup_2)  # -> out, P; inputs obj: list of String, pts: list of Point3d, fwd: list of Vector3d, up: list of Vector3d
# ---------- c_script: C# usings ----------
using System.IO;
using System.Linq;
# ---------- c_script: C# ----------
    string ghpath = this.Component.OnPingDocument().FilePath;
    string folder = new FileInfo(ghpath).Directory.FullName;
    string name = Path.GetFileNameWithoutExtension(Rhino.RhinoDoc.ActiveDoc.Name);
    string filepath = folder + "\\" + name + ".csv";

    //delete file if existing
    if(File.Exists(filepath))
    {
      try{File.Delete(filepath);}
      catch{Print("Close File Before Proceeding"); return;}
    }


    //create data to export to file
    List<string> data = new List<string>();
    string headers = "Layer,PositionX,PositionY,PositionZ,ForwardX,ForwardY,ForwardZ,NormalX,NormalY,NormalZ";
    data.Add(headers);
    for(int i = 0;i < obj.Count;i++)
    {
      //get info
      string layer = obj[i];
      Point3d position = pts[i];
      Vector3d forward = fwd[i];
      Vector3d normal = up[i];

      //add info as a row
      string[] info = new string[]{
        layer,(-position.X).ToString(),position.Z.ToString(),(-position.Y).ToString(),
        forward.X.ToString(),forward.Z.ToString(),forward.Y.ToString(),
        normal.X.ToString(),normal.Z.ToString(),normal.Y.ToString()
        };
      string row = string.Join(",", info);
      data.Add(row);
    }

    //add all data to the file
    System.IO.File.WriteAllLines(filepath, data.ToArray());
    P = filepath;
# ---------- end c_script ----------
panel_2 = Panel(c_script.P)
panel_3 = Panel(c_script.out)
